# Requirement set Req_SW (R2023b)

## 1 [Requierments_Klimaanlage!RequiermentsKlimaAnlage] References to Requierments_Klimaanlage.xlsx (RequiermentsKlimaAnlage) (Container)
Read-only references to Microsoft Excel document.

### 1.1 [1] Die Klimaanlagensteuerung muss die Temperatur auf eine voreingestellte Zieltemperatur zwischen 16°C und 28°C regeln können.

### 1.2 [2] Die Software muss die Klimaanlage so steuern, dass sie die Innenraumtemperatur in maximal 5 Minuten um mindestens 10°C herunterkühlt oder aufheizen kann.

### 1.3 [3] Die Software muss die Innenraumtemperatur auf ±1°C der eingestellten Zieltemperatur halten.

### 1.4 [4] Die Klimaanlage muss basierend auf der Innenraum- und Außentemperatur selbständig die Innenraumtemperatur auf den vom Nutzer eingestellten Sollwert regeln.

### 1.5 [5] Die Software muss eine Fehlererkennungsfunktion implementieren, die bei einem Außentemperaturen ab -20°C und niedriger, sowie +50°C und höher einen Sicherheitsmodus aktiviert.

### 1.6 [6] Die Software muss eine Fehlererkennungsfunktion implementieren, die bei einem Energieverbrauch größer als 5kW einen Sicherheitsmodus aktiviert.

### 1.7 [7] Im Sicherheitsmodus muss die Klimaanlage deaktiviert werden bis der Energieverbrauch wieder unter 5kW und die Temperatur wieder über -20°C oder unter 50°C beträgt.

### 1.8 [8] Die Regelung der Innentemperatur muss mit einem on-off button gestoppt und gestartet werden können

### 1.9 [9] Es muss eine Nutzerausgabe geben, die die derzeitige Eingestellte Temperatur anzeigt